# Grasshopper definition 01_ConvertLineCurveToNURBSCurve.gh (Grasshopper 1.0.7)

number_slider = Slider(12, range=0..100)
random = Random(Range=number_slider, Number="3", Seed=Slider(48, range=0..100))
random_2 = Random(Range=number_slider, Number="3", Seed=Slider(56, range=0..100))
list_item = ListItem(List=random_2, Index=0, Wrap=True)  # -> Item, Item1, Item2
list_item_2 = ListItem(List=random, Index=0, Wrap=True)  # -> Item, Item1, Item2
x = GetNumber(list_item_2.Item, AtLeast=1, AtMost=1, Maximum=1.797693135e+308, Minimum=-1.797693135e+308)
y = GetNumber(list_item_2.Item1, AtLeast=1, AtMost=1, Maximum=1.797693135e+308, Minimum=-1.797693135e+308)
z = GetNumber(list_item_2.Item2, AtLeast=1, AtMost=1, Maximum=1.797693135e+308, Minimum=-1.797693135e+308)
u = GetNumber(list_item.Item, AtLeast=1, AtMost=1, Maximum=1.797693135e+308, Minimum=-1.797693135e+308)
v = GetNumber(list_item.Item1, AtLeast=1, AtMost=1, Maximum=1.797693135e+308, Minimum=-1.797693135e+308)
w = GetNumber(list_item.Item2, AtLeast=1, AtMost=1, Maximum=1.797693135e+308, Minimum=-1.797693135e+308)
constructorconvertlinecurvetonurbscurve = ConstructorConvertLineCurveToNURBSCurve(x=x, y=y, z=z, u=u, v=v, w=w)  # -> out, OutLineCurve, OutNurbsCurve, Pt0, Pt1; inputs x: Int32, y: Int32, z: Int32, u: Int32, v: Int32, w: Int32
# ---------- constructorconvertlinecurvetonurbscurve: C# usings ----------
using System.IO;
using System.Linq;
using System.Data;
using System.Drawing;
using System.Reflection;
using System.Windows.Forms;
using System.Xml;
using System.Xml.Linq;
using System.Runtime.InteropServices;

using Rhino.DocObjects;
using Rhino.Collections;
using GH_IO;
using GH_IO.Serialization;
# ---------- constructorconvertlinecurvetonurbscurve: C# ----------
    //Create an instance of a line curve
    Point3d p0 = new Point3d(x, y, z);
    Point3d p1 = new Point3d(u, v, w);

    LineCurve line_crv = new LineCurve(p0, p1);
    OutLineCurve = line_crv;

    //convert LineCurve to a NurbsCurve
    NurbsCurve nc = line_crv.ToNurbsCurve();
    OutNurbsCurve = nc;

    Pt0 = p0;
    Pt1 = p1;
# ---------- end constructorconvertlinecurvetonurbscurve ----------

# ---- group: RH_OUT:lineCrv
curve = Curve(constructorconvertlinecurvetonurbscurve.OutLineCurve)

# ---- group: RH_OUT:pt0
point = Point(constructorconvertlinecurvetonurbscurve.Pt0)

# ---- group: RH_OUT:pt1
point_2 = Point(constructorconvertlinecurvetonurbscurve.Pt1)

# ---- group: RH_OUT:nurbsCrv
curve_2 = Curve(constructorconvertlinecurvetonurbscurve.OutNurbsCurve)
