# Grasshopper definition 01_CreateRotatedEllispes.gh (Grasshopper 1.0.7)

count = GetInteger(Slider(7, range=0..10), AtLeast=1, AtMost=1, Maximum=2147483647, Minimum=-2147483648)
radangles = GetNumber(Slider(0.24, range=0..2), AtLeast=1, AtMost=1, Maximum=1.797693135e+308, Minimum=-1.797693135e+308)
xshift = GetNumber(Slider(4.72, range=0..10), AtLeast=1, AtMost=1, Maximum=1.797693135e+308, Minimum=-1.797693135e+308)
constructorcreaterotatedellispes = ConstructorCreateRotatedEllispes(radAngles=radangles, count=count, XShift=xshift)  # -> out, OutCurves; inputs radAngles: Double, count: Int32, XShift: Double
# ---------- constructorcreaterotatedellispes: C# usings ----------
using System.IO;
using System.Linq;
using System.Data;
using System.Drawing;
using System.Reflection;
using System.Windows.Forms;
using System.Xml;
using System.Xml.Linq;
using System.Runtime.InteropServices;

using Rhino.DocObjects;
using Rhino.Collections;
using GH_IO;
using GH_IO.Serialization;
# ---------- constructorcreaterotatedellispes: C# ----------
    double R = radAngles; //angle in radian
    int N = count; //number of ellipses
    double X = XShift; // shift along X axis

    //Declare a new list of ellipse curve type
    List<Ellipse> eList = new List<Ellipse>();

    //Use a loop to create a number of ellipse curves
    Plane plane = Plane.WorldXY;

    for (Int32 i = 1; i <= N; i++) {
      Point3d pt = new Point3d(X, 0, 0);
      Vector3d Y = new Vector3d(0, 1, 0);
      plane.Rotate(R * i, Y, pt);

      //Declare and instantiate a new ellipse
      Ellipse C = new Ellipse(plane, (double) i / 2, i);

      //Add the ellipse to the list
      eList.Add(C);
    }

    //Assign the list to the output value A
    OutCurves = eList;
# ---------- end constructorcreaterotatedellispes ----------

# ---- group: RH_OUT:curves
curve = Curve(constructorcreaterotatedellispes.OutCurves)

# ---- group: RH_OUT:shell
loft = Loft(Curves=curve, Options={Adjust=False, Closed=False, LoftEnds=0, LoftSimp=0, LoftType=0, Rebuild=10, Refit=0.01})
