# Grasshopper definition 01_methodPointDistance.gh (Grasshopper 1.0.7)

number_slider = Slider(3, range=0..10)
construct_point = ConstructPoint(XCoordinate=Slider(3, range=0..10), YCoordinate=0, ZCoordinate=Slider(7, range=0..10))
radial = Radial(Plane=PlaneXY(0, 0, 0), Size=Slider(2, range=0..10), ExtentR=number_slider, ExtentP=number_slider)  # -> Cells, Points
deconstruct = Deconstruct(Point=construct_point)  # -> XComponent, YComponent, ZComponent
other_points = GetPoint(radial.Points, AtLeast=1, AtMost=1, Realtime=True)
y = GetNumber(deconstruct.YComponent, AtLeast=1, AtMost=1, Maximum=1.797693135e+308, Minimum=-1.797693135e+308)
x = GetNumber(deconstruct.XComponent, AtLeast=1, AtMost=1, Maximum=1.797693135e+308, Minimum=-1.797693135e+308)
z = GetNumber(deconstruct.ZComponent, AtLeast=1, AtMost=1, Maximum=1.797693135e+308, Minimum=-1.797693135e+308)
methodpointdistance = MethodPointDistance(x=x, y=y, z=z, other=other_points)  # -> out, Point, Distance; inputs x: Double, y: Double, z: Double, other: Point3d
# ---------- methodpointdistance: C# usings ----------
using System.IO;
using System.Linq;
using System.Data;
using System.Drawing;
using System.Reflection;
using System.Windows.Forms;
using System.Xml;
using System.Xml.Linq;
using System.Runtime.InteropServices;

using Rhino.DocObjects;
using Rhino.Collections;
using GH_IO;
using GH_IO.Serialization;
# ---------- methodpointdistance: C# ----------
    //Create an instance of a point and initialize to x, y and z
    Point3d pt = new Point3d(x, y, z);

    //Declare a distance variable and initialize to "0"
    double dis = 0;

    //Calculate the distance from "pt" to the "other" input point
    dis = pt.DistanceTo(other);

    //Assign the point "pt" to the A output
    Point = pt;

    //Assign the distance to the B output
    Distance = dis;
# ---------- end methodpointdistance ----------

# ---- group: RH_OUT:distance
number = Number(methodpointdistance.Distance)

# ---- group: RH_OUT:Points
point = Point(methodpointdistance.Point)

# ----
panel = Panel(methodpointdistance.Distance)
