# Grasshopper definition 01_operatorAddTwoPoints.gh (Grasshopper 1.0.7)

construct_point = ConstructPoint(XCoordinate=0, YCoordinate=0, ZCoordinate=0)
unit_z = UnitZ(Factor=Slider(5, range=0..100))
move = Move(Geometry=construct_point, Motion=Vector(0, 0, 10))  # -> Geometry, Transform
move_2 = Move(Geometry=construct_point, Motion=unit_z)  # -> Geometry, Transform
pt1 = GetPoint(move.Geometry, AtLeast=1, AtMost=1, Realtime=True)
pt2 = GetPoint(move_2.Geometry, AtLeast=1, AtMost=1, Realtime=True)
operatoraddtwopoints = OperatorAddTwoPoints(pt1=pt1, pt2=pt2)  # -> out, Point; inputs pt1: Point3d, pt2: Point3d
# ---------- operatoraddtwopoints: C# usings ----------
using System.IO;
using System.Linq;
using System.Data;
using System.Drawing;
using System.Reflection;
using System.Windows.Forms;
using System.Xml;
using System.Xml.Linq;
using System.Runtime.InteropServices;

using Rhino.DocObjects;
using Rhino.Collections;
using GH_IO;
using GH_IO.Serialization;
# ---------- operatoraddtwopoints: C# ----------
    //Add 2 points and assign result to output
    Point = pt1 + pt2;
# ---------- end operatoraddtwopoints ----------

# ---- group: RH_OUT:added_point
point = Point(operatoraddtwopoints.Point)
