# Grasshopper definition 02_methodExtractIsoCurveFromSurface.gh (Grasshopper 1.0.7)

geometry = Geometry(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)
get_geometry = GetGeometry(geometry, AtLeast=1, AtMost=1, Filter=1073741848)
p = GetNumber(Slider(0.751, range=0..1), AtLeast=1, AtMost=1, Maximum=1.797693135e+308, Minimum=-1.797693135e+308)
surface = Surface(reparameterize(get_geometry))
methodextractisocurvefromsurface = MethodExtractIsoCurveFromSurface(srf=surface, p=p)  # -> out, OutIsoCurve; inputs srf: Surface, p: Double
# ---------- methodextractisocurvefromsurface: C# ----------
    var isoCurve = srf.IsoCurve(0, p);
    OutIsoCurve = isoCurve;
# ---------- end methodextractisocurvefromsurface ----------

# ---- group: RH_OUT:isoCurves
curve = Curve(methodextractisocurvefromsurface.OutIsoCurve)
