# Grasshopper definition 02_methodGetCurveTangentVectorAtStartCurve.gh (Grasshopper 1.0.7)

range = Range(Domain=Slider(3, range=0..10), Steps=Slider(10, range=0..100))
sine = Sine(Value=range)
cosine = Cosine(Value=range)
construct_point = ConstructPoint(XCoordinate=range, YCoordinate=sine, ZCoordinate=cosine)
interpolate = Interpolate(Vertices=construct_point, Degree=3, Periodic=False, KnotStyle=1)  # -> Curve, Length, Domain
crv = GetGeometry(interpolate.Curve, AtLeast=1, AtMost=1, Filter=1073741828)
methodgetcurvetangentvectoratstartcurve = MethodGetCurveTangentVectorAtStartCurve(crv=crv)  # -> out, StartPoint, TangentVector; inputs crv: Curve
# ---------- methodgetcurvetangentvectoratstartcurve: C# usings ----------
using System.IO;
using System.Linq;
using System.Data;
using System.Drawing;
using System.Reflection;
using System.Windows.Forms;
using System.Xml;
using System.Xml.Linq;
using System.Runtime.InteropServices;

using Rhino.DocObjects;
using Rhino.Collections;
using GH_IO;
using GH_IO.Serialization;
# ---------- methodgetcurvetangentvectoratstartcurve: C# ----------
    //Get the tangent at start
    Vector3d tangent = crv.TangentAtStart;

    //Get the start point
    Point3d pt = crv.PointAtStart;

    //Output
    StartPoint = pt;
    TangentVector = tangent;
# ---------- end methodgetcurvetangentvectoratstartcurve ----------

# ---- group: RH_OUT:startPoint
point = Point(methodgetcurvetangentvectoratstartcurve.StartPoint)

# ---- group: RH_OUT:tangentVector
vector = Vector(methodgetcurvetangentvectoratstartcurve.TangentVector)

# ----
vector_display = VectorDisplay(Anchor=methodgetcurvetangentvectoratstartcurve.StartPoint, Vector=vector)
