# Grasshopper definition 02_methodMultipleOffsetOfCurve.gh (Grasshopper 1.0.7)

construct_point = ConstructPoint(XCoordinate=0, YCoordinate=0, ZCoordinate=0)
negative = Negative(Value=Slider(2.65, range=0..10))
curve = Curve(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)
crv = GetGeometry(curve, AtLeast=1, AtMost=1, Filter=1073741828)
num = GetInteger(Slider(3, range=0..10), AtLeast=1, AtMost=1, Maximum=2147483647, Minimum=-2147483648)
dis = GetNumber(negative, AtLeast=1, AtMost=1, Maximum=1.797693135e+308, Minimum=-1.797693135e+308)
tol = GetNumber(Slider(0.001, range=0..0.001), AtLeast=1, AtMost=1, Maximum=1.797693135e+308, Minimum=-1.797693135e+308)
plane = GetPoint(construct_point, AtLeast=1, AtMost=1, Realtime=True)
methodmultipleoffsetofcurve = MethodMultipleOffsetOfCurve(crv=crv, num=num, dis=dis, tol=tol, plane=plane)  # -> out, OutCurves; inputs crv: Curve, num: Int32, dis: Double, tol: Double, plane: Plane
# ---------- methodmultipleoffsetofcurve: C# usings ----------
using System.IO;
using System.Linq;
using System.Data;
using System.Drawing;
using System.Reflection;
using System.Windows.Forms;
using System.Xml;
using System.Xml.Linq;
using System.Runtime.InteropServices;

using Rhino.DocObjects;
using Rhino.Collections;
using GH_IO;
using GH_IO.Serialization;
# ---------- methodmultipleoffsetofcurve: C# ----------
    //Declare the list of curve
    List<Curve> crvs = new List<Curve>();

    //The curve to offset
    Curve last_crv = crv;

    //Create offset curves
    for (int i = 1; i <= num; i++) {
      //offset
      Curve[] crv_array = last_crv.Offset(plane, dis, tol, CurveOffsetCornerStyle.None);

      //Ignore if output is multiple offset curves
      if (crv.IsValid && crv_array.Count() == 1) {
        //append offset curve to array
        crvs.Add(crv_array[0]);

        //update the next curve to offset
        last_crv = crv_array[0];
      } else {
        break;
      }
    }

    //Assign output
    OutCurves = crvs;
# ---------- end methodmultipleoffsetofcurve ----------

# ---- group: RH_OUT:offsetCrvs
curve_2 = Curve(methodmultipleoffsetofcurve.OutCurves)
