# Grasshopper definition 03_CreateSurfaceBetweenTwoSurfaces.gh (Grasshopper 1.0.7)

number_slider = Slider(100, range=0..100)
construct_domain = ConstructDomain(DomainStart=Slider(0, range=0..10), DomainEnd=Slider(10, range=0..10))
construct_domain_2 = ConstructDomain(DomainStart=Slider(0, range=0..10), DomainEnd=Slider(10, range=0..10))
number_slider_2 = Slider(10, range=0..10)
range = Range(Domain=construct_domain, Steps=number_slider)
range_2 = Range(Domain=construct_domain_2, Steps=number_slider)
cosine = Cosine(Value=range_2)
sine = Sine(Value=range)
addition = Addition(A=number_slider_2, B=range)
addition_2 = Addition(A=number_slider_2, B=range_2)
addition_3 = Addition(A=sine, B=Slider(1.624, range=0..10))
construct_point = ConstructPoint(XCoordinate=addition, YCoordinate=addition_3, ZCoordinate=range)
construct_point_2 = ConstructPoint(XCoordinate=addition_2, YCoordinate=cosine, ZCoordinate=range_2)
construct_point_3 = ConstructPoint(XCoordinate=range, YCoordinate=addition_3, ZCoordinate=range)
construct_point_4 = ConstructPoint(XCoordinate=range_2, YCoordinate=cosine, ZCoordinate=range_2)
interpolate = Interpolate(Vertices=construct_point, Degree=3, Periodic=False, KnotStyle=1)  # -> Curve, Length, Domain
interpolate_2 = Interpolate(Vertices=construct_point_3, Degree=3, Periodic=False, KnotStyle=1)  # -> Curve, Length, Domain
interpolate_3 = Interpolate(Vertices=construct_point_4, Degree=3, Periodic=False, KnotStyle=1)  # -> Curve, Length, Domain
interpolate_4 = Interpolate(Vertices=construct_point_2, Degree=3, Periodic=False, KnotStyle=1)  # -> Curve, Length, Domain
loft = Loft(
    Curves=[interpolate.Curve, interpolate_2.Curve],
    Options={Adjust=False, Closed=False, LoftEnds=0, LoftSimp=0, LoftType=0, Rebuild=10, Refit=0.01})
loft_2 = Loft(
    Curves=[interpolate_4.Curve, interpolate_3.Curve],
    Options={Adjust=False, Closed=False, LoftEnds=0, LoftSimp=0, LoftType=0, Rebuild=10, Refit=0.01})
srfa = GetGeometry(loft, AtLeast=1, AtMost=1, Filter=1073741848)
srfb = GetGeometry(loft_2, AtLeast=1, AtMost=1, Filter=1073741848)
radius = GetNumber(Slider(10, range=0..10), AtLeast=1, AtMost=1, Maximum=1.797693135e+308, Minimum=-1.797693135e+308)
tol = GetNumber(Slider(0.001, range=0..0.001), AtLeast=1, AtMost=1, Maximum=1.797693135e+308, Minimum=-1.797693135e+308)
staticmethodcreatesurfacebetweentwosurfa = StaticMethodCreateSurfaceBetweenTwoSurfaces(srfA=srfa, srfB=srfb, radius=radius, tol=tol)  # -> out, OutSurfaces; inputs srfA: Surface, srfB: Surface, radius: Double, tol: Double
# ---------- staticmethodcreatesurfacebetweentwosurfa: C# usings ----------
using System.IO;
using System.Linq;
using System.Data;
using System.Drawing;
using System.Reflection;
using System.Windows.Forms;
using System.Xml;
using System.Xml.Linq;
using System.Runtime.InteropServices;

using Rhino.DocObjects;
using Rhino.Collections;
using GH_IO;
using GH_IO.Serialization;
# ---------- staticmethodcreatesurfacebetweentwosurfa: C# ----------
    //Declare an array of surfaces
    Surface[] surfaces = {};

    //Check for a valid input
    if (srfA != null && srfB != null) {
      //Create fillet surfaces
      surfaces = Surface.CreateRollingBallFillet(srfA, srfB, radius, tol);
    }

    //Output
    OutSurfaces = surfaces;
# ---------- end staticmethodcreatesurfacebetweentwosurfa ----------

# ---- group: RH_OUT:surfaces
surface = Surface(staticmethodcreatesurfacebetweentwosurfa.OutSurfaces)
