# Grasshopper definition 03_constructorCreatePlanarSurfaceFromPlaneAnd2Intervals.gh (Grasshopper 1.0.7)

u1 = GetNumber(Slider(0.13, range=0..1), AtLeast=1, AtMost=1, Maximum=1.797693135e+308, Minimum=-1.797693135e+308)
u2 = GetNumber(Slider(0.22, range=0..1), AtLeast=1, AtMost=1, Maximum=1.797693135e+308, Minimum=-1.797693135e+308)
v1 = GetNumber(Slider(0.75, range=0..1), AtLeast=1, AtMost=1, Maximum=1.797693135e+308, Minimum=-1.797693135e+308)
v2 = GetNumber(Slider(0.9, range=0..1), AtLeast=1, AtMost=1, Maximum=1.797693135e+308, Minimum=-1.797693135e+308)
constructorcreateplanarsurfacefromplanea = ConstructorCreatePlanarSurfaceFromPlaneAnd2Intervals(u1=u1, v1=v1, u2=u2, v2=v2)  # -> out, PlanarSurface; inputs u1: Double, v1: Double, u2: Double, v2: Double
# ---------- constructorcreateplanarsurfacefromplanea: C# ----------
    var plane = Plane.WorldXY;
    var x_interval = new Interval(u1, v1);
    var y_interval = new Interval(u2, v2);

    var planeSrf = new PlaneSurface(plane, x_interval, y_interval);

    PlanarSurface = planeSrf;
# ---------- end constructorcreateplanarsurfacefromplanea ----------

# ---- group: RH_OUT:planarSrf
geometry = Geometry(constructorcreateplanarsurfacefromplanea.PlanarSurface)
