# Grasshopper definition 04_moveFacesAwayFromCenter.gh (Grasshopper 1.0.7)

brep = Brep(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)
brep_2 = GetGeometry(brep, AtLeast=1, AtMost=1, Filter=1073741840)
movefacesawayfromcenter = MoveFacesAwayFromCenter(brep=brep_2)  # -> out, A; inputs brep: Brep
# ---------- movefacesawayfromcenter: C# usings ----------
using System.IO;
using System.Linq;
using System.Data;
using System.Drawing;
using System.Reflection;
using System.Windows.Forms;
using System.Xml;
using System.Xml.Linq;
using System.Runtime.InteropServices;

using Rhino.DocObjects;
using Rhino.Collections;
using GH_IO;
using GH_IO.Serialization;
# ---------- movefacesawayfromcenter: C# ----------
    //Declare a new ist of faces
    List<Brep> faces = new List<Brep>();

    //Find the center
    Point3d center = brep.GetBoundingBox(true).Center;

    //Check all the faces
    for (int i = 0; i <= brep.Faces.Count - 1; i++) {
      //extract the faces
      int[] i_list = { i };
      Brep face = brep.DuplicateSubBrep(i_list);

      //Find face center
      Point3d face_center = face.GetBoundingBox(true).Center;

      //Find moving direction
      Vector3d dir = new Vector3d();
      dir = face_center - center;

      //move the face
      face.Translate(dir);

      //Add to the list
      faces.Add(face);
    }

    //Assign output
    A = faces;
# ---------- end movefacesawayfromcenter ----------

# ---- group: RH_OUT:surfaces
geometry = Geometry(movefacesawayfromcenter.A)

# ----
panel = Panel(geometry)
