# Grasshopper definition 04_navigatingTopologyOfBrep.gh (Grasshopper 1.0.7)

brep = Brep(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)
brep_2 = GetGeometry(brep, AtLeast=1, AtMost=1, Filter=1073741848)
navigatingtopologyofbrep = NavigatingTopologyOfBrep(brep=brep_2)  # -> out, Faces, FaceSurfaces, Loops2DCurves, Loops3DCurves, Edges, Trims2DCurves, Vertices; inputs brep: Brep
# ---------- navigatingtopologyofbrep: C# ----------
    Rhino.Geometry.Collections.BrepFaceList faces = brep.Faces;
    List<Rhino.Geometry.Surface> surfaces = new List<Rhino.Geometry.Surface>();
    for(int fi = 0; fi < faces.Count; fi++)
    {
      BrepFace face = faces[fi];
      //Get Adjacent faces
      var aFaces = face.AdjacentFaces();
      //Get Adjacent edges
      var aEdges = face.AdjacentEdges();
      //Get face loops
      var faceLoops = face.Loops;
      //Get the 3D untrimmed surface
      var face3dSurface = face.UnderlyingSurface();
      surfaces.Add(face3dSurface);
    }
    Faces = faces;
    FaceSurfaces = surfaces;

    //BrepLoop topology (2D parameter space)
    Rhino.Geometry.Collections.BrepLoopList loops = brep.Loops;
    List<Rhino.Geometry.Curve> loops2DCrvs = new List<Rhino.Geometry.Curve>();
    List<Rhino.Geometry.Curve> loops3DCrvs = new List<Rhino.Geometry.Curve>();
    for(int li = 0; li < loops.Count; li++)
    {
      BrepLoop loop = loops[li];
      //Get loop face
      var loopFace = loop.Face;
      //Get loop trims
      var loopTrims = loop.Trims;
      //Get loop 2D and 3D curves
      var loop2dCurve = loop.To2dCurve();
      var loop3dCurve = loop.To3dCurve();
      loops2DCrvs.Add(loop2dCurve);
      loops3DCrvs.Add(loop3dCurve);
    }
    Loops2DCurves = loops2DCrvs;
    Loops3DCurves = loops3DCrvs;

    //BrepEdge topology (3D modeling space)
    Rhino.Geometry.Collections.BrepEdgeList edges = brep.Edges;
    for(int ei = 0; ei < edges.Count; ei++)
    {
      BrepEdge edge = edges[ei];
      //Get edge faces
      var eFaces_i = edge.AdjacentFaces();
      //Get edge start and end vertices
      var eStartVertex = edge.StartVertex;
      var eEndVertex = edge.EndVertex;
      //Get edge trim indices
      var eTrimIndeces = edge.TrimIndices();
      //Get edge 3D curve
      var e3dCurve = edge.EdgeCurve;
    }
    Edges = edges;

    //BrepTrim topology (2D parameter space)
    Rhino.Geometry.Collections.BrepTrimList trims = brep.Trims;
    for(int ti = 0; ti < trims.Count; ti++)
    {
      BrepTrim trim = trims[ti];
      //Get the edge
      var trimEdge = trim.Edge;
      //Get trim start and end vertices
      var trimStartVertex = trim.StartVertex;
      var trimEndVertex = trim.EndVertex;
      //Get trim loop
      var trimLoop = trim.Loop;
      //Get trim face
      var trimFace = trim.Face;
      //Get trim 2D curve
      var trim2dCurve = trim.TrimCurve;
    }
    Trims2DCurves = trims;

    //BrepVertex topology (3D modeling space)
    Rhino.Geometry.Collections.BrepVertexList vertices = brep.Vertices;
    for(int vi = 0; vi < vertices.Count; vi++)
    {
      BrepVertex vertex = vertices[vi];
      //Get vertex edges
      var vEdges = vertex.EdgeIndices();
      //Get vertex location
      var vPoint = vertex.Location;
    }
    Vertices = vertices;
# ---------- end navigatingtopologyofbrep ----------

# ---- group: RH_OUT:faceSurfaces
surface = Surface(navigatingtopologyofbrep.FaceSurfaces)

# ---- group: RH_OUT:trims2DCurves
curve = Curve(navigatingtopologyofbrep.Trims2DCurves)

# ---- group: RH_OUT:verticies
point = Point(navigatingtopologyofbrep.Vertices)

# ---- group: RH_OUT:faces
surface_2 = Surface(navigatingtopologyofbrep.Faces)

# ---- group: RH_OUT:loops2DCurves
curve_2 = Curve(navigatingtopologyofbrep.Loops2DCurves)

# ---- group: RH_OUT:loops3DCurves
curve_3 = Curve(navigatingtopologyofbrep.Loops3DCurves)

# ---- group: RH_OUT:edges
curve_4 = Curve(navigatingtopologyofbrep.Edges)
