# Grasshopper definition 05_changeVerticiesLocationsRandomly1.gh (Grasshopper 1.0.7)

trigger = Trigger(Interval=100, TimerInterval=100, Target=data_recorder)
data_recorder = DataRecorder(Slider(0, range=0..10), DataLimit=-10, RecordData=False)
list_length = ListLength(List=data_recorder)
sine = Sine(Value=list_length)
absolute = Absolute(Value=sine)
mesh = Mesh(<mesh referenced from the Rhino model>)
multiplication = Multiplication(A=Slider(72, range=0..100), B=absolute)
mesh_2 = GetGeometry(mesh, AtLeast=1, AtMost=1, Filter=1073741856)
amp = GetNumber(multiplication, AtLeast=1, AtMost=1, Maximum=1.797693135e+308, Minimum=-1.797693135e+308)
panel = Panel(multiplication)
changeverticieslocationsrandomly1 = ChangeVerticiesLocationsRandomly1(mesh=mesh_2, amp=amp)  # -> out, OutMesh; inputs mesh: Mesh, amp: Int32
# ---------- changeverticieslocationsrandomly1: C# usings ----------
using System.IO;
using System.Linq;
using System.Data;
using System.Drawing;
using System.Reflection;
using System.Windows.Forms;
using System.Xml;
using System.Xml.Linq;
using System.Runtime.InteropServices;

using Rhino.DocObjects;
using Rhino.Collections;
using GH_IO;
using GH_IO.Serialization;
# ---------- changeverticieslocationsrandomly1: C# ----------
    //Change mesh vertex location
    int index = 0;
    Random rand = new Random();
    foreach (Point3f loc in mesh.Vertices) {
      Point3f new_loc = loc;
      new_loc.Z = rand.Next(amp) / 3;
      mesh.Vertices[index] = new_loc;
      index = index + 1;
    }

    //Assign output
    OutMesh = mesh;
# ---------- end changeverticieslocationsrandomly1 ----------

# ---- group: RH_OUT:mesh
mesh_3 = Mesh(changeverticieslocationsrandomly1.OutMesh)

# ----
panel_2 = Panel(mesh_3)
